# Grasshopper definition Streamer.gh (Grasshopper 0.9.76)
# plug-ins: MeshEdit Components, GrasshopperClient, LunchBox, Weaverbird

number_slider = Slider(0.18, range=0..0.3)
pt = ConstructPoint(XCoordinate=0, YCoordinate=0, ZCoordinate=Slider(0.54, range=0..2))
pt_2 = ConstructPoint(XCoordinate=number_slider, YCoordinate=0, ZCoordinate=0)
pt_3 = ConstructPoint(XCoordinate=number_slider, YCoordinate=0, ZCoordinate=Slider(1.73, range=0..2))
pt_4 = ConstructPoint(XCoordinate=0, YCoordinate=0, ZCoordinate=0)
wbprism = WeaverbirdsMeshPrism(
    Plane=pt_4,
    Width=Slider(0.43, range=0..1),
    NumberOfSides=Slider(5, range=0..10),
    TopPoint=pt,
    BasePolygonMethod=True,
    FillStrategy=1)
wbpyramid = WeaverbirdsMeshPyramid(
    Plane=pt_2,
    Width=Slider(0.4, range=-0.4..0.6),
    NumberOfSides=Slider(8, range=0..10),
    TopPoint=pt_3,
    BasePolygonMethod=True,
    FillStrategy=1)
merge = Merge(Data1=wbpyramid, Data2=wbprism)
merge_2 = Merge(Data1=pt_2, Data2=pt_4)
mesh = Mesh(merge)
pln = Plane(merge_2)
scale = Scale(Geometry=mesh, Center=pln, Factor=Slider(0.13, range=0.01..1))  # -> Geometry, Transform
tri = Triangulate(Mesh=scale.Geometry)  # -> Mesh, Count
demesh = DeconstructMesh(Mesh=tri.Mesh)  # -> Vertices, Faces, Colours, Normals
lng = ListLength(List=demesh.Vertices)
series = Series(Start=0, Step=1, Count=lng)
gradient = Gradient(LowerLimit=0, UpperLimit=lng, Parameter=series, stops=[0: RGB(0, 128, 0), 0.5: RGB(255, 255, 0), 1: RGB(255, 0, 0)])
conmesh = ConstructMesh(Vertices=demesh.Vertices, Faces=demesh.Faces, Colours=gradient)
mjoin = MeshJoin(Meshes=flatten(conmesh))

# ---- group: Read positions from Firebase
pt_5 = Point(<point referenced from the Rhino model>)
list = ValueList({"Unity": 0, "Rhino": 1}, selected="Unity")
pt_6 = Point(<point referenced from the Rhino model>)
pt_7 = Point(<point referenced from the Rhino model>)
pr = PositionReader(Run=Toggle(False))  # -> CameraPosition, LeftHandPosition, RightHandPosition
filter = StreamFilter(Gate=list, Stream0=pr.CameraPosition, Stream1=pt_6)
filter_2 = StreamFilter(Gate=list, Stream0=pr.RightHandPosition, Stream1=pt_5)
filter_3 = StreamFilter(Gate=list, Stream0=pr.LeftHandPosition, Stream1=pt_7)
panel = Panel(pr.CameraPosition)
panel_2 = Panel(pr.LeftHandPosition)
panel_3 = Panel(pr.RightHandPosition)

# ---- group: Read positions from Firebase / Camera
pt_8 = Point(filter)

# ---- group: Read positions from Firebase / Right Hand
pt_9 = Point(filter_2)

# ---- group: Read positions from Firebase / Left Hand
pt_10 = Point(filter_3)

# ----
neg = Negative(Value=Slider(0.55, range=0..10))
line = LineSDL(Start=pt_8, Direction=Vector(0, 0, 1), Length=neg)
curvepoint = PointOnCurve(line, parameter=0.24)
ln = Line(StartPoint=curvepoint, EndPoint=[pt_9, pt_10])
sph = Sphere(Base=[pt_9, pt_10], Radius=Slider(0.05, range=0..0.1))
sph_2 = Sphere(Base=pt_8, Radius=Slider(0.1, range=0..0.1))

# ---- group: Mesh
number_slider_2 = Slider(0.4, range=0..1)
number_slider_3 = Slider(0.4, range=0..10)
division = Division(A=number_slider_2, B=Slider(2, range=0..10))
neg_2 = Negative(Value=division)
number_slider_4 = Slider(0.5, range=0..1)
pt_11 = ConstructPoint(XCoordinate=neg_2, YCoordinate=number_slider_3, ZCoordinate=0)
pt_12 = ConstructPoint(XCoordinate=number_slider_2, YCoordinate=number_slider_3, ZCoordinate=0)
line_2 = LineSDL(Start=pt_12, Direction=Vector(0, 0, 1), Length=number_slider_4)
line_3 = LineSDL(Start=pt_11, Direction=Vector(0, 0, 1), Length=number_slider_4)
loft = Loft(
    Curves=[line_3, line_2],
    Options={Adjust=False, Closed=False, LoftEnds=0, LoftSimp=0, LoftType=0, Rebuild=10, Refit=0.01})
diamond = DiamondPanels(Surface=loft, UDivisions=Slider(12, range=0..100), VDivisions=Slider(6, range=0..100))  # -> DiamondPanels, TriPanels
edges = BrepEdges(Brep=diamond.DiamondPanels)  # -> Naked, Interior, NonManifold
pln_2 = Plane(loft)
deplane = DeconstructPlane(Plane=pln_2)  # -> Origin, XAxis, YAxis, ZAxis
amp = Amplitude(Vector=deplane.ZAxis, Amplitude=Slider(0.05, range=0..0.1))

# ---- group: Paint Mesh according to distance to camera
area = Area(Geometry=diamond.DiamondPanels)  # -> Area, Centroid
dist = Distance(PointA=area.Centroid, PointB=pt_8)

# ---- group: Mesh (continued)
scale_2 = Scale(Geometry=edges.Naked, Center=graft(area.Centroid), Factor=Slider(0.9, range=0..1))  # -> Geometry, Transform
join = JoinCurves(Curves=scale_2.Geometry, Preserve=False)
boundary = BoundarySurfaces(Edges=join)  # -> flatten(Surfaces)
extr = Extrude(Base=boundary, Direction=amp)
smesh = SimpleMesh(Brep=extr)
tri_2 = Triangulate(Mesh=smesh)  # -> Mesh, Count
mesh_2 = Mesh(tri_2.Mesh)

# ---- group: Move pieces according to hand movement
dist_2 = Distance(PointA=area.Centroid, PointB=pt_10)
dist_3 = Distance(PointA=area.Centroid, PointB=pt_9)
c_script = CSharpScript(r=dist_3, l=dist_2, t=Slider(0.25, range=0..1))  # -> out, A; inputs r: Double, l: Double, t: Double
# ---------- c_script: C# ----------
    double d = 0.0;
    if(r < l) d = r;
    else d = l;

    if(d < t) A = -(0.25 - d);
    else A = 0.0;
# ---------- end c_script ----------
amp_2 = Amplitude(Vector=deplane.ZAxis, Amplitude=c_script.A)
move = Move(Geometry=mesh_2, Motion=amp_2)  # -> Geometry, Transform

# ---- group: Paint Mesh according to distance to camera (continued)
sort = SortList(Keys=dist, ValuesA=move.Geometry)  # -> Keys, ValuesA
demesh_2 = DeconstructMesh(Mesh=sort.ValuesA)  # -> Vertices, Faces, Colours, Normals
lng_2 = ListLength(List=tri_2.Mesh)
series_2 = Series(Start=0, Step=1, Count=lng_2)
gradient_2 = Gradient(
    LowerLimit=0,
    UpperLimit=lng_2,
    Parameter=series_2,
    stops=[0: RGB(234, 38, 0), 0.25: RGB(234, 126, 0), 0.5: RGB(254, 244, 84), 0.75: RGB(173, 203, 249), 1: RGB(75, 107, 169)])
conmesh_2 = ConstructMesh(Vertices=demesh_2.Vertices, Faces=demesh_2.Faces, Colours=graft(gradient_2))  # -> flatten(Mesh)

# ---- group: Send to Firebase
mjoin_2 = MeshJoin(Meshes=conmesh_2)
unifynormals = MeshUnifyNormals(Mesh=mjoin_2)
gc = ARGrasshopperClient(Run=Toggle(False), Mesh=flatten(unifynormals))
