# Grasshopper definition building structure stream.gh (Grasshopper 0.9.76)
# plug-ins: GrasshopperClient, Mesh Pipe

# ---- group: Parameters
list = ValueList({"Rectangle": 0, "Circle": 1}, selected="Circle")
number_slider = Slider(75, range=0..100)
building_height = Slider(114, range=0..1000)
number_slider_2 = Slider(0, range=0..100)
number_of_sides = Slider(4, range=0..15)
floors_2 = Slider(2, range=0..100)
number_slider_3 = Slider(46, range=0..100)
number_slider_4 = Slider(0, range=0..100)
floor_color = ColourSwatch(SwatchColor=RGB(0, 0, 106))
structure_color = ColourSwatch(SwatchColor=RGB(255, 255, 46))
scale_factor = Slider(0.001, range=0.001..0.01)

# ---- group: Logic
pt = ConstructPoint(XCoordinate=number_slider_2, YCoordinate=number_slider_4, ZCoordinate=0)
rectangle = Rectangle(Plane=pt, XSize=number_slider, YSize=number_slider_3, Radius=0)  # -> Rectangle, Length
cir = Circle(Plane=pt, Radius=number_slider_3)
filter = StreamFilter(Gate=list, Stream0=rectangle.Rectangle, Stream1=cir)
Z = UnitZ(Factor=building_height)
line = LineSDL(Start=pt, Direction=Vector(0, 0, 1), Length=building_height)
extr = Extrude(Base=filter, Direction=Z)
multiplication = Multiplication(A=floors_2, B=Slider(2, range=0..10))
divide = DivideCurve(Curve=line, Count=floors_2, Kinks=False)  # -> Points, Tangents, Parameters
toggle = BooleanToggle(False)
divide_2 = DivideCurve(Curve=line, Count=multiplication, Kinks=False)  # -> Points, Tangents, Parameters
sec = BrepPlane(Brep=extr, Plane=divide.Points)  # -> Curves, Points
sec_2 = BrepPlane(Brep=extr, Plane=divide_2.Points)  # -> Curves, Points
addition = Addition(A=floors_2, B=Slider(1, range=0..1))
series = Series(Start=0, Step=1, Count=addition)
divide_3 = DivideCurve(Curve=sec.Curves, Count=number_of_sides, Kinks=toggle)  # -> Points, Tangents, Parameters
divide_4 = DivideCurve(Curve=sec_2.Curves, Count=number_of_sides, Kinks=toggle)  # -> Points, Tangents, Parameters
neg = Negative(Value=series)
pline = PolyLine(Vertices=divide_4.Points, Closed=True)
shift = ShiftList(List=divide_3.Points, Shift=graft(series), Wrap=True)
shift_2 = ShiftList(List=divide_3.Points, Shift=graft(neg), Wrap=True)
flip = FlipMatrix(Data=shift_2)
flip_2 = FlipMatrix(Data=shift)
pline_2 = PolyLine(Vertices=flip_2, Closed=False)
pline_3 = PolyLine(Vertices=flip, Closed=False)
boundary = BoundarySurfaces(Edges=pline)
Z_2 = UnitZ(Factor=Slider(1, range=0..10))
move = Move(Geometry=boundary, Motion=Z_2)  # -> Geometry, Transform
extr_2 = Extrude(Base=pline, Direction=Z_2)

# ----
join = BrepJoin(Breps=[boundary, move.Geometry, extr_2])  # -> flatten(Breps), Closed
mesh = MeshBrep(
    Brep=join.Breps,
    Settings={GridMaxCount=0, GridMinCount=16, JaggedSeams=False, MaxEdgeLength=0, MinEdgeLength=0.0001, MinTolerance=0, Refine=True, RefineAngle=0, RelativeTolerance=0.65, SimplePlanes=True, Tolerance=0})
mpipe = MeshPipe(
    Curve=[pline_2, pline_3],
    Radius=Slider(0.5, range=0..1),
    Accuracy=0.2,
    Rotation=0,
    Segments=Slider(8, range=0..10),
    Caps=0)
demesh = DeconstructMesh(Mesh=mesh)  # -> Vertices, Faces, Colours, Normals
demesh_2 = DeconstructMesh(Mesh=mpipe)  # -> Vertices, Faces, Colours, Normals
conmesh = ConstructMesh(Vertices=demesh.Vertices, Faces=demesh.Faces, Colours=floor_color)
conmesh_2 = ConstructMesh(Vertices=demesh_2.Vertices, Faces=demesh_2.Faces, Colours=structure_color)
tri = Triangulate(Mesh=conmesh_2)  # -> Mesh, Count
tri_2 = Triangulate(Mesh=conmesh)  # -> Mesh, Count
mjoin = MeshJoin(Meshes=flatten([tri_2.Mesh, tri.Mesh]))
scale = Scale(Geometry=mjoin, Center=pt, Factor=scale_factor)  # -> Geometry, Transform
gc = ARGrasshopperClient(Run=Toggle(False), Mesh=scale.Geometry)
